# Grasshopper definition 01_BasicStart.gh (Grasshopper 0.9.76)
# plug-ins: Colibri

Z = Panel("""3
5""")
# Input Parameters
# Iterator now supports:
# 1) Number Slider
# 2) Value List
# 3) Panel
X = Slider(1, range=1..10)
Y = ValueList({"2.5", "3", "4", "6"}, selected="2.5")

# ---- group: RH_Input
# copyright: Thornton Tomasetti, Inc.
# Author: Mingbo Peng
# MPeng@ThorntonTomasetti.com
# Date: 04/06/2017
# Revision: 1
# GH: 0.9.0076
# Description:
pt = Point(Point(0, 0, 0))

# balah ekn dkehag shier fjrea; dakehfn kd ka jeaiw akkhae adfga
# dakehfn kd ka jeaiw akkhae agieahaa jjes stwq ajehga alae fgaeefaf
# agieahaa jjes stwq ajehga alae abue jiues naa bnal laep uey afdffa
# abue jiues naa bnal laep uey ier fjrea; dakehfn kd ka jeaiw oguyt rtyh
pt_2 = Point(Point(0, 0, 0))

# ----
# 01
# Colibri Iterator
# Controls upsteam conponents
iterator = ColibriFlyIDIterator(X=X, Y=Y, Z=Z, ignoreAllWarningMsg=False, RemoteFly=False)  # -> X, Y, Z, Genome

# ---- group: Input
pt_3 = Point(Point(0, 0, 0))

pt_4 = Point(Point(0, 0, 0))

# ---- group: Operation
pt_5 = Point(Point(0, 0, 0))

pt_6 = Point(Point(0, 0, 0))

# ----
current_item_from_z = Panel(iterator.Z)
iteration_id_genome = Panel(iterator.Genome)

# ---- group: Output
pt_7 = Point(Point(0, 0, 0))

pt_8 = Point(Point(0, 0, 0))

# ---- group: Visualization
# Best Practices: Large grouped elements: Alpha:120.
# Single grouped elements: Alpha: 225.
# Rhino Inputs: Orange. Hue: 30. "RH_"
# Other Inputs: Yellow. Hue: 60
# Operations: Purple. Hue: 265
# Outputs: Red. Hue 0.
# Custom Visualization: Green. Hue: 120.
# All inputs listed on left.
# All outputs listed on right.
# Global Instructions at top left corner on white.
# Local Instructions next to GH code on white.
# Large Header for each "Step" above GH code.
# Frequently label GH components for description.
pt_9 = Point(Point(0, 0, 0))

pt_10 = Point(Point(0, 0, 0))

# ----
box = DomainBox(Base=PlaneXY(0, 0, 0), X=X, Y=Y, Z=current_item_from_z)
area = Area(Geometry=box)  # -> Area, Centroid
wires = BrepWireframe(Brep=box, Density=-1)
# Output Parameters
volume = Volume(Geometry=box)  # -> Volume, Centroid
len = Length(Curve=wires)
ma = MassAddition(Input=len)  # -> Result, PartialResults
total_length_m = Panel(ma.Result)
volume_m3 = Panel(volume.Volume)
area_m2 = Data(area.Area)
# 02
# Colibri Parameter
# Formats data
parameters = ColibriParameters(Volume_m3=flatten(volume_m3), Area_m2=flatten(area_m2), Total_length_m=flatten(total_length_m))

# ----
# Image settings
panel = Panel("800")
img_setting = ImageSetting(ImageSaveAsName="defaultName", Width=panel, Height=panel)

# ----
# 03
# Colibri Aggregator
# Exports data, images, 3Dmodels
aggregator = ColibriAggregator(
    Folder="C:\Colibri",
    IterationGenomeID=iterator.Genome,
    IterationPhenomeResults=parameters,
    Write=Toggle(False),
    recordingMode=3)
