# Grasshopper definition 02_Advanced.gh (Grasshopper 0.9.76)
# plug-ins: Spectacles.GrasshopperExporter, Colibri

Y = Slider(3, range=1..10)
X = Slider(1, range=1..10)
box = DomainBox(Base=PlaneXY(0, 0, 0), X=X, Y=Y, Z=Domain(0, 0.25))

# ---- group: RH_Input
# copyright: Thornton Tomasetti, Inc.
# Author: Mingbo Peng
# MPeng@ThorntonTomasetti.com
# Date: 04/06/2017
# Revision: 1
# GH: 0.9.0076
# Description:
pt = Point(Point(0, 0, 0))

# balah ekn dkehag shier fjrea; dakehfn kd ka jeaiw akkhae adfga
# dakehfn kd ka jeaiw akkhae agieahaa jjes stwq ajehga alae fgaeefaf
# agieahaa jjes stwq ajehga alae abue jiues naa bnal laep uey afdffa
# abue jiues naa bnal laep uey ier fjrea; dakehfn kd ka jeaiw oguyt rtyh
pt_2 = Point(Point(0, 0, 0))

# ---- group: Input
pt_3 = Point(Point(0, 0, 0))

# Iterator Settings
pt_4 = Point(Point(0, 0, 0))

# ----
# Image Settings
panel = Panel("""Top
Perspective""")
# 3D model Settings
panel_2 = Panel("600")
img_setting = ImageSetting(ImageSaveAsName="defaultName", RhinoViewNames=panel, Width=panel_2, Height=panel_2)

# ----
# Params Settings
volume = Volume(Geometry=box)  # -> Volume, Centroid
parameters = ColibriParameters(V=flatten(volume.Volume))

# ---- group: Model for export
brep = Brep(box)

# ----
# 3) Combo setting
# In this case:
# Evenly take 5 values from "X" parameter;
# Evenly take 5 values from "Y" parameter;
# 
# Now we have 5x5 = 25 Iterations in total;
# Then run from #0 to #20 iteration from above 25
panel_3 = Panel("""5
5""")
dom = ConstructDomain(DomainStart="0", DomainEnd="20")
sel = IterationSelection(Divisions=panel_3, Domains=dom)
panel_4 = Panel(dom)

# ----
# 1) Division setting
# In this case:
# Evenly take 6 values from "X" parameter;
# Evenly take 3 values from "Y" parameter;
panel_5 = Panel("""6
3""")
sel_2 = IterationSelection(Divisions=panel_5)

# ----
# 2) Domain setting
# In this case:
# Run from #0 to #20 iteration
# Accepts multi-domains
panel_6 = Panel("0")
dom_2 = ConstructDomain(DomainStart=panel_6, DomainEnd="20")
panel_7 = Panel(dom_2)
sel_3 = IterationSelection(Domains=dom_2)

# ---- group: Operation
pt_5 = Point(Point(0, 0, 0))

pt_6 = Point(Point(0, 0, 0))

# ----
wires = BrepWireframe(Brep=brep, Density=-1)
mesh = Mesh(brep)
mcol = MeshColours(Mesh=mesh, Colours=ColourSwatch(SwatchColor=RGB(255, 0, 0)))
spectacles_line = Spectacles_Line(Line=wires)
spectacles_meshcoloredvertices = Spectacles_MeshColoredVertices(Mesh=mcol)
sceneobjects = Spectacles_SceneObjects(Elements=flatten([spectacles_meshcoloredvertices, spectacles_line]))

# ---- group: Output
pt_7 = Point(Point(0, 0, 0))

pt_8 = Point(Point(0, 0, 0))

# ---- group: Visualization
# Best Practices: Large grouped elements: Alpha:120.
# Single grouped elements: Alpha: 225.
# Rhino Inputs: Orange. Hue: 30. "RH_"
# Other Inputs: Yellow. Hue: 60
# Operations: Purple. Hue: 265
# Outputs: Red. Hue 0.
# Custom Visualization: Green. Hue: 120.
# All inputs listed on left.
# All outputs listed on right.
# Global Instructions at top left corner on white.
# Local Instructions next to GH code on white.
# Large Header for each "Step" above GH code.
# Frequently label GH components for description.
pt_9 = Point(Point(0, 0, 0))

pt_10 = Point(Point(0, 0, 0))

# ----
# Right click the Iterator for
# "Fly Test"
# "Fly Test" will ignore Selection settings,
# and randomly pick 3 Iterations
iterator = ColibriFlyIDIterator(X=X, Y=Y, ignoreAllWarningMsg=False, RemoteFly=False)  # -> X, Y, Value_N, Genome

# ----
# Right click the Aggregator for
# override mode setting
# 1) Clean the folder,
#      and run all Iterations
# 
# 2) Do not clean the folder,
#      run all Iterations,
#      and append data to the end of CSV file
# 
# 3) Do not clean the folder,
#      run the Iterations if not exist in current CSV,
#      and append new data to the end of CSV file.
# 
# 4) Ask me everytime if the folder is not empty
aggregator = ColibriAggregator(
    Folder="c:\Colibri",
    IterationGenomeID=iterator.Genome,
    IterationPhenomeResults=parameters,
    ImgSetting=img_setting,
    _3DObjects=flatten(sceneobjects),
    Write=Toggle(False),
    recordingMode=3)
recorded_data = Panel(aggregator)
