# Grasshopper definition 03_WorkWithGalapagos.gh (Grasshopper 0.9.76)
# plug-ins: Colibri

chain_length = Slider(286.13, range=10..1000)
crv = Curve(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)
pt = Point([Point(-49.94976008, 0, -126.0947265), Point(-93.82921712, 0, -50.53088579), Point(-19.38183205, 0, -90.11037929)])
end = EndPoints(Curve=crv)  # -> Start, End
Z = UnitZ(Factor=1)
rev = Reverse(Vector=Z)
cat = Catenary(PointA=end.Start, PointB=end.End, Length=chain_length, Gravity=rev)
crv_cp = CurveClosestPoint(Point=pt, Curve=cat)  # -> Point, Parameter, Distance
ma = MassAddition(Input=crv_cp.Distance)  # -> Result, PartialResults
cumulative_distance = Number(ma.Result)
parameters = ColibriParameters(Cumulative_Distance=flatten(cumulative_distance))
parameters_2 = ColibriParameters(ChainLength=flatten(chain_length))
galapagos = Galapagos(fitness=ma, gene=chain_length)
aggregator = ColibriAggregator(
    Folder="C:\Colibri",
    IterationGenomeID=parameters_2,
    IterationPhenomeResults=parameters,
    Write=Toggle(False),
    recordingMode=3)
