# Grasshopper definition BoxTest.gh (Grasshopper 0.9.76)
# plug-ins: Colibri, CORE.Grasshopper.Spectacles

# ---- group: Colibri Iterator Inputs
button = Button()
steps = Panel("""2
3
10""")

# ---- group: Box Parameters
length = Slider(1, range=1..10)
height = Slider(1, range=1..10)
width = Slider(1, range=1..10)

# ---- group: RH_Input
# copyright: Thornton Tomasetti, Inc.
# Date: 1/7/2017
# Revision: 1
# GH: 0.9.0076
pt = Point(Point(0, 0, 0))

pt_2 = Point(Point(0, 0, 0))

# ---- group: Colibri Iterator
iterator = Iterator(Sliders=[length, width, height], Steps=steps, Fly=button)

# ---- group: Create Box
box = CenterBox(Base=PlaneXY(0, 0, 0), X=length, Y=width, Z=height)
brep = Brep(box)

# ---- group: Input
pt_3 = Point(Point(0, 0, 0))

pt_4 = Point(Point(0, 0, 0))

# ---- group: Operation
pt_5 = Point(Point(0, 0, 0))

pt_6 = Point(Point(0, 0, 0))

# ---- group: Volume Output
volume = Volume(Geometry=brep)  # -> Volume, Centroid
colibri_outputs = ColibriOutputs(Names="Volume", Values=volume.Volume)

# ---- group: Output
pt_7 = Point(Point(0, 0, 0))

pt_8 = Point(Point(0, 0, 0))

# ---- group: Visualization
pt_9 = Point(Point(0, 0, 0))

pt_10 = Point(Point(0, 0, 0))

# ---- group: Colibri Aggregator Inputs
image_parameters = ImageParameters(Width=400, Height=400)
write_files = BooleanToggle(False)
panel = Panel("C:\Users\bhowes\Desktop\Colibri\Box_20170109")

# ---- group: Colibri Aggregator
aggregator = Aggregator(Folder=panel, Inputs=iterator, Outputs=colibri_outputs, ImgParams=image_parameters, Write=write_files)

# ---- group: Spectacles Model
number_slider = Slider(0.5, range=0..1)
swatch = ColourSwatch(SwatchColor=RGB(255, 0, 140))
spectacles_meshlambertmaterial = Spectacles_MeshLambertMaterial(Color=swatch, AmbientColor=swatch, EmissiveColor=RGB(0, 0, 0), Object_Opacity=number_slider, SmoothEdges=True)
spectacles_mesh = Spectacles_Mesh(Mesh=brep, MeshMaterial=spectacles_meshlambertmaterial)
spectacles_scenecompiler = Spectacles_SceneCompiler(Write=write_files, FilePath=aggregator, Elements=flatten(spectacles_mesh))

# ---- group: RH Display
material = CreateMaterial(
    Diffuse=ColourSwatch(SwatchColor=RGB(255, 0, 140)),
    Specular=RGB(255, 255, 255),
    Emission=RGB(0, 0, 0),
    Transparency=number_slider,
    Shine=0)
preview = CustomPreview(Geometry=brep, Shader=material)
