# Grasshopper definition Demo.gh (Grasshopper 0.9.76)
# plug-ins: Colibri

width = Slider(14, range=0..50)
wwr = Slider(60, range=0..100)
number_slider = Slider(79, range=0..100)
u_value = Slider(0.579, range=0..1)

# ----
# Iterator
iterator = Iterator(
    Sliders=[width, wwr, number_slider, u_value],
    Steps=[Slider(1, range=0..10), Slider(5, range=0..10), Slider(10, range=0..10), Slider(5, range=0..10)],
    Fly=Button())
# Colibri
# Formater
panel = Panel("C:\DesignExplorer")
formatoutputs = FormatOutputs(OutputNames="100", OutputValues="100")
imageparameter = ImageParameter(WidthInput=500, HeightInput=500)
aggregator = Aggregator(
    FolderPath=panel,
    InputsDataSet=iterator,
    OutputsDataSet=formatoutputs,
    ImageParams=imageparameter,
    WriteFile=Toggle(False))  # -> WriteInData, SpectaclesFileName
# Aggregator
button = Button()
# Uploader
uploader = Uploader(FolderPath=panel, Upload=button)
