# Grasshopper definition GalapagosTest.gh (Grasshopper 0.9.76)
# plug-ins: Colibri

chain_length = Slider(286.13, range=10..1000)

# ---- group: Hanging Chain Input Geometry
# copyright: Thornton Tomasetti, Inc.
# Date: 1/7/2017
# Revision: 1
# GH: 0.9.0076
pt = Point([Point(-49.94976008, 0, -126.0947265), Point(-93.82921712, 0, -50.53088579), Point(-19.38183205, 0, -90.11037929)])
crv = Curve(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)

# ---- group: Catenary
Z = UnitZ(Factor=1)
rev = Reverse(Vector=Z)
end = EndPoints(Curve=crv)  # -> Start, End
cat = Catenary(PointA=end.Start, PointB=end.End, Length=chain_length, Gravity=rev)

# ---- group: RH_Input
pt_2 = Point(Point(0, 0, 0))

pt_3 = Point(Point(0, 0, 0))

# ---- group: Input
pt_4 = Point(Point(0, 0, 0))

pt_5 = Point(Point(0, 0, 0))

# ----
galapagos = Galapagos(fitness=ma, gene=chain_length)

# ---- group: Operation
pt_6 = Point(Point(0, 0, 0))

pt_7 = Point(Point(0, 0, 0))

# ---- group: Distance to attractors
crv_cp = CurveClosestPoint(Point=pt, Curve=cat)  # -> Point, Parameter, Distance
ma = MassAddition(Input=crv_cp.Distance)  # -> Result, PartialResults

# ---- group: Output
pt_8 = Point(Point(0, 0, 0))

pt_9 = Point(Point(0, 0, 0))

# ---- group: Visualization
pt_10 = Point(Point(0, 0, 0))

pt_11 = Point(Point(0, 0, 0))

# ---- group: Colibri
colibri_inputs = ColibriInputs(Sliders=chain_length)
image_parameters = ImageParameters(Width=400, Height=400)
num = Number(ma.Result)
colibri_outputs = ColibriOutputs(Names="Cumulative Distance", Values=num)
aggregator = Aggregator(
    Folder="C:\Users\bhowes\Desktop\Colibri\GalapagosChain_20161220",
    Inputs=colibri_inputs,
    Outputs=colibri_outputs,
    ImgParams=image_parameters,
    Write=Toggle(False))
