# Grasshopper definition FolderCheck.gh (Grasshopper 0.9.76)
# plug-ins: Colibri

sdfde = Slider(5, range=0..10)
wwr = Slider(7, range=0..10)
colibri_outputs = ColibriOutputs(Names="test", Values=Slider(5, range=0..10))
iterator = Iterator(Sliders=[sdfde, wwr], Fly=Button())
image_parameters = ImageParameters(ImageName="11", Width=400, Height=400)
panel = Panel(colibri_outputs)
panel_2 = Panel(iterator)
panel_3 = Panel(image_parameters)
toggle = BooleanToggle(False)
aggregator = Aggregator(Folder="C:\ladybug\E", Inputs=panel_2, Outputs=panel)
