# Grasshopper definition Iterator2Testing.gh (Grasshopper 0.9.76)
# plug-ins: Colibri

wwr = Slider(0.484, range=0..1)
ddd = Slider(10, range=0..10)
windows = Panel("""2
55""")
listdd = ValueList({"One": 1, "Two": 2, "Three": 2² - 1, "Four": Sqrt(16)}, selected="One")
rename = Slider(0.25, range=0..1)
panel = Panel(windows)
iterator = IteratorFly(ValueList_Listdd=listdd, ValueList_Listdd_2=listdd, Unsupported=Toggle(False), Fly=Toggle(False))  # -> Listdd, Listdd_2, Unsupported, Item, Inputs
c_script = CSharpScript(x=listdd, y=windows)  # -> out, A; inputs y: list
# ---------- c_script: C# ----------
    Grasshopper.Kernel.IGH_Param inputParam = Component.Params.Input[1].Sources[0];
    Grasshopper.Kernel.Special.GH_Panel panelParam = inputParam as Grasshopper.Kernel.Special.GH_Panel;
    //panelParam.Properties.Multiline = false;
    //panelParam.UserText = "2";
    var userList = panelParam.UserText.Length;
    A = userList;
# ---------- end c_script ----------
panel_2 = Panel(c_script.A)
panel_3 = Panel(iterator.Listdd)
fly = Ladybug_fly()  # -> Vviiiiiiiiiizzz; plug-in component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
