# Grasshopper definition iterator testing.gh (Grasshopper 0.9.76)
# plug-ins: Colibri

panel = Panel("""2
2
2""")
mingbo = Slider(0, range=0..4)
ana = Slider(0, range=0..4)
olivier = Slider(0, range=0..4)
iterator = Iterator(Sliders=[mingbo, ana, olivier], Steps=panel, Fly=Button())
panel_2 = Panel(iterator)
