# Grasshopper definition Workflow Sketch.gh (Grasshopper 0.9.76)
# plug-ins: CORE.Grasshopper.Spectacles, DesignExplorerGrasshopper

depth = Slider(0.029, range=0..1)
height = Slider(0, range=0..1)
merge = Merge(Data1=depth, Data2=height)
panel = Panel("""15
10""")
c_script = CSharpScript(X=merge, Y=panel)  # -> Out, A
spectacles_meshbasicmaterial = Spectacles_MeshBasicMaterial(Object_Opacity=1)
dummy = Dummy(Hello=Slider(0.397, range=0..1), World=Slider(0.25, range=0..1))
panel_2 = Panel("""volume
area""")

# ---- group: ITERATOR
c_script_2 = CSharpScript(Sliders=merge, Steps=panel, Run=Button())  # -> Out, Inputs

# ----
spectacles_mesh = Spectacles_Mesh(Mesh=c_script.A, MeshMaterial=spectacles_meshbasicmaterial)
panel_3 = Panel(dummy)

# ---- group: FormatOutputs
c_script_3 = CSharpScript(OutputNames=panel_2, OutputValues=c_script.A)

# ---- group: Image Parameters
c_script_4 = CSharpScript()

# ---- group: Aggregator
c_script_5 = CSharpScript(
    Directory="C:\Users\bhowes\Desktop\Dummy",
    Inputs=c_script_2.Inputs,
    Outputs=c_script_3,
    ImageParams=c_script_4,
    SpectaclesElements=spectacles_mesh,
    WriteFile=Toggle(False))  # -> Out, A
