# Grasshopper definition WorkflowSketch_MP.gh (Grasshopper 0.9.76)
# plug-ins: Python Interpreter, Colibri

depth = Slider(0.029, range=0..1)
height = Slider(0, range=0..1)
dddd = Slider(6, range=0..10)
ss = Slider(9, range=0..10)
number_slider = Slider(0.397, range=0..1)
number_slider_2 = Slider(0.25, range=0..1)
merge = Merge(Data1=depth, Data2=height)
panel = Panel("""15
10""")
c_script = CSharpScript(X=merge, Y=panel)  # -> Out, A
iterator = Iterator(Sliders=[ss, dddd], Steps=[Slider(6, range=0..10), Slider(6, range=0..10)], Fly=Toggle(False))
panel_2 = Panel("""volume
area""")

# ---- group: ITERATOR
c_script_2 = CSharpScript(Sliders=merge, Steps=panel, Run=Button())  # -> Out, Inputs

# ----
panel_3 = Panel(iterator)
panel_4 = Panel("C:\Users\Mingbo\Desktop")
c_script_3 = CSharpScript(x=iterator)  # -> out, A
# ---------- c_script_3: C# ----------
    A = x.GetType();
# ---------- end c_script_3 ----------

# ---- group: FormatOutputs
c_script_4 = CSharpScript(OutputNames=panel_2, OutputValues=c_script.A)

# ---- group: Image Parameters
c_script_5 = CSharpScript()

# ----
panel_5 = Panel(c_script_3.A)
number_slider_3 = Slider(100, range=0..100)
panel_6 = Panel("""height
width""")
panel_7 = Panel("C:\Users\Mingbo\Documents\GitHub\Colibri.Grasshopper\src\MP_test")
dddd_2 = Slider(8, range=0..10)
ss_2 = Slider(9, range=0..10)
panel_8 = Panel("""height
width
wwr""")
panel_9 = Panel("""sda
da
daylight""")
panel_10 = Panel("1")
imageparameter = ImageParameter(WidthInput=number_slider_3, HeightInput=number_slider_3, Bool=Toggle(True))

# ---- group: Aggregator
c_script_6 = CSharpScript(
    Directory="C:\Users\bhowes\Desktop\Dummy",
    Inputs=c_script_2.Inputs,
    Outputs=c_script_4,
    ImageParams=c_script_5,
    WriteFile=Toggle(False))  # -> Out, A

# ----
c_script_7 = CSharpScript()  # -> out, A
# ---------- c_script_7: C# ----------
    Dictionary<string, string> openWith = 
      new Dictionary<string, string>();

    // Add some elements to the dictionary. There are no 
    // duplicate keys, but some of the values are duplicates.
    openWith.Add("txt", "notepad.exe");
    openWith.Add("bmp", "paint.exe");
    openWith.Add("dib", "paint.exe");
    openWith.Add("rtf", "wordpad.exe");
    
    A = openWith;
# ---------- end c_script_7 ----------
c_script_8 = CSharpScript()  # -> out, A
# ---------- c_script_8: C# ----------
    Dictionary<string, string> openWith =
      new Dictionary<string, string>();

    // Add some elements to the dictionary. There are no
    // duplicate keys, but some of the values are duplicates.
    openWith.Add("cooling", "5");
    openWith.Add("Heating", "2");
    openWith.Add("daylight", "100");
    openWith.Add("comfort", "10");

    A = openWith;
# ---------- end c_script_8 ----------
toggle = BooleanToggle(False)
formatoutputs = FormatOutputs(OutputNames=panel_6, OutputValues=[Slider(50, range=0..100), Slider(32, range=0..100)])
formatoutputs_2 = FormatOutputs(OutputNames="threeD", OutputValues="05.json")
formatoutputs_3 = FormatOutputs(OutputNames=panel_9, OutputValues=[Slider(22, range=0..100), Slider(51, range=0..100), Slider(64, range=0..100)])
formatoutputs_4 = FormatOutputs(OutputNames=panel_8, OutputValues=[dddd_2, ss_2, Slider(0.5, range=0..1)])
panel_11 = Panel(formatoutputs_3)
c_script_9 = CSharpScript(folder=panel_7, inData=c_script_7.A, outData=c_script_8.A, writeFile=toggle)  # -> out, A; inputs folder: String, inData: list, outData: list, writeFile: Boolean
# ---------- c_script_9: C# ----------
    bool run = writeFile;
    string csvPath = Convert.ToString(folder) + "/data.csv";
    string imagePath = "10.png";
    string threeDPath = "10.json";

    var rawData = inData;
    int inDataLength = rawData.Count;
    rawData.AddRange(outData);

    string keyReady = "";
    string valueReady = "";
    //List < string > titles = inData.ToList();



    for (int i = 0; i < rawData.Count; i++){
      string item = Convert.ToString(rawData[i]).Replace("[", "").Replace("]", "").Replace(" ", "");
      string dataKey = item.Split(',')[0];
      string dataValue = item.Split(',')[1];

      if (i > 0){

        if (i < inDataLength){

          //   A = dataKey;
          keyReady += ",in:" + dataKey;
        }else{
          keyReady += ",out:" + dataKey;
        }

        valueReady = valueReady + "," + dataValue;

      }else{

        //the first set
        keyReady = "in:" + dataKey;
        valueReady += dataValue;
      }




    }


    if (run){
      string writeInData = "";

      //check csv file
      if (!File.Exists(csvPath)){
        keyReady = keyReady + ",img,threeD" + Environment.NewLine;
        File.WriteAllText(csvPath, keyReady);
      }

      writeInData = string.Format("{0},{1},{2}\n", valueReady, imagePath, threeDPath);
      File.AppendAllText(csvPath, writeInData);


      A = writeInData;



    }
# ---------- end c_script_9 ----------
panel_12 = Panel(formatoutputs)
panel_13 = Panel(imageparameter)
panel_14 = Panel(c_script_7.A)
panel_15 = Panel(formatoutputs_4)
panel_16 = Panel(formatoutputs_2)
c_script_10 = CSharpScript(folder=panel_7, inData=c_script_7.A, outData=c_script_8.A, writeFile=toggle)  # -> out, A; inputs folder: String, inData: list, outData: list, writeFile: Boolean
# ---------- c_script_10: C# ----------
    bool run = writeFile;
    string csvPath = Convert.ToString(folder) + "/data.csv";

    string threeDPath = "10.json";

    var rawData = inData;
    int inDataLength = rawData.Count;
    rawData.AddRange(outData);

    string keyReady = "";
    string valueReady = "";
    //List < string > titles = inData.ToList();


    var sc = Rhino.RhinoDoc.ActiveDoc;
    int width = 500;
    int height = 500;

    Size viewSize = new Size(width, height);
    string imagePath = @"C:\Users\Mingbo\Documents\GitHub\Colibri.Grasshopper\src\MP_test\01.png";
    var pic = Rhino.RhinoDoc.ActiveDoc.Views.ActiveView.CaptureToBitmap(viewSize);
    pic.Save(imagePath);

    A = sc.Views.ActiveView.ActiveViewport.Size.Width;



    for (int i = 0; i < rawData.Count; i++){
      string item = Convert.ToString(rawData[i]).Replace("[", "").Replace("]", "").Replace(" ", "");
      string dataKey = item.Split(',')[0];
      string dataValue = item.Split(',')[1];

      if (i > 0){

        if (i < inDataLength){

          //   A = dataKey;
          keyReady += ",in:" + dataKey;
        }else{
          keyReady += ",out:" + dataKey;
        }

        valueReady = valueReady + "," + dataValue;

      }else{

        //the first set
        keyReady = "in:" + dataKey;
        valueReady += dataValue;
      }

    }


    if (run){
      string writeInData = "";

      //check csv file
      if (!File.Exists(csvPath)){
        keyReady = keyReady + ",img,threeD" + Environment.NewLine;
        File.WriteAllText(csvPath, keyReady);
      }

      writeInData = string.Format("{0},{1},{2}\n", valueReady, imagePath, threeDPath);
      File.AppendAllText(csvPath, writeInData);


      //A = writeInData;



    }
# ---------- end c_script_10 ----------
panel_17 = Panel("C:\Users\Mingbo\Documents\GitHub\Colibri.Grasshopper\docs\TestWorkflows")
c_script_11 = CSharpScript()  # -> out, A; same code as c_script_7
c_script_12 = CSharpScript()  # -> out, A; same code as c_script_8
panel_18 = Panel(c_script_10.A)
panel_19 = Panel(c_script_10.out)
aggregator = Aggregator(
    Folder=panel_17,
    Inputs=formatoutputs_4,
    Outputs=formatoutputs_3,
    ImageParams=imageparameter,
    SpectaclesElements_3D="05.json",
    WriteFile=Toggle(True))
panel_20 = Panel(aggregator)
captureview = Ladybug_CaptureView()  # -> imagePath; plug-in component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
readasc = CSharpScript()  # -> out, Titles, Monitorpos, WC_layers, RawData; inputs x: String, year: Int32
# ---------- readasc: C# ----------
    List<string> lines = File.ReadAllLines(x.Replace("\"", ""), System.Text.Encoding.GetEncoding(1252)).ToList();

    //select data of year
    int ds = (year - 1) * 8760 + 1;
    int de = year * 8760 + 1;
    if (year == 0){
      ds = 1;
      de = lines.Count;
    }else if (year == -1){
      ds = ((lines.Count - 10) / 8760) * 8760 + 1;
      de = lines.Count;
    }else if (de > lines.Count){
      de = lines.Count;
    }

    //
    //var titles = lines[0].Split('\t').ToList();
    List < string > titles = lines[0].Split('\t').ToList();
    titles.RemoveRange(0, 1); // remove "Date/Time"
    Titles = titles;

    //Material list
    List < string > monitorpos = new List<string>{};
    List < string > wc_layers = new List<string>{};





    int catecounts = lines[1].Split('\t').Length - 1;
    var data = new List<List<object>>{};

    for(int i = 0; i < catecounts; i++){
      data.Add(new List<object>{});
      string [] header = titles[i].Split('[');
      data[i].Add("key:location/dataType/units/frequency/HOYstartsAt/HOYendsAt");
      data[i].Add(header[0]);

      if(titles[i].Contains("Temperature")){
        data[i].Add("Temperature");
      }else if (titles[i].Contains("Relative Humidity")){
        data[i].Add("Relative Humidity");
      }else if (titles[i].Contains("Water Content")){
        data[i].Add("Water Content");
      }else{
        data[i].Add(header[0]);
      }

      data[i].Add("[" + header[1]);
      if (year == 0){
        data[i].Add("Hourly (All Years)");
      }else if(year == -1){
        data[i].Add("Hourly (Final Year)");
      }else{
        data[i].Add("Hourly (Year " + year + ")");
      }
      data[i].Add("HOYstartsAt:" + ds);
      data[i].Add("HOYendsAt:" + de);

      if((titles[i].IndexOf("Monitorpos") > 0) && (titles[i].StartsWith("Temperature"))){
        monitorpos.Add(titles[i]);
      }else if (titles[i].StartsWith("Water")){
        wc_layers.Add(titles[i]);
      }
    }

    Monitorpos = monitorpos;
    WC_layers = wc_layers;


    for(int l = ds; l < de; l++){
      string [] items = lines[l].Split('\t');
      for(int i = 0; i < catecounts; i++){
        data[i].Add(Convert.ToDouble(items[i + 1]));
      }
    }
    RawData = data;
# ---------- end readasc ----------
moisture = CSharpScript()  # -> out, moistureContent; inputs waterContent: list
# ---------- moisture: C# ----------
    List <object> mc = new List<object>();
    var wc = waterContent.Skip(7).ToList();

    foreach (string item in waterContent.Take(7)){
      if (item.Contains("Water Content")){
        mc.Add(item.Replace("Water", "Moisture"));
      }else if (item.Contains("[lb/ft³]")){
        mc.Add(item.Replace("lb/ft³", "%"));
      }else{
        mc.Add(item);
      }
    }

    var nums = Enumerable.Range(0, wc.Count());
    var query = from i in nums.AsParallel().AsOrdered()
        select (Convert.ToDouble(wc[i]) / Convert.ToDouble(bulkDensity));

    query.ToList().ForEach(i => mc.Add(i));
    moistureContent = mc;
# ---------- end moisture ----------
freeze = CSharpScript()  # -> out, F; inputs T: list, RH: list
# ---------- freeze: C# ----------
    List <object> f = new List<object>();
    var t = T.GetRange(7, T.Count() - 7);
    var rh = RH.GetRange(7, RH.Count() - 7);
    var cwc = CWC;
    
    foreach (var item in T.GetRange(0, 7)){
      if (Convert.ToString(item).Contains("Temperature")){
        f.Add(Convert.ToString(item).Replace("Temperature", "Freeze/Thaw Cycle"));
      }else if (Convert.ToString(item).Contains("[°F]")){
        f.Add(Convert.ToString(item).Replace("[°F]", "True/False"));
      }else{
        f.Add(item);
      }
    }

    var nums = Enumerable.Range(0, t.Count());
    var query = from i in nums.AsParallel().AsOrdered()
        select calFreeze(Convert.ToDouble(t[i]), Convert.ToDouble(rh[i]), Convert.ToDouble(cwc));

    query.ToList().ForEach(i => f.Add(i));
    F = f;
# ---------- freeze: C# additional code ----------
  public bool calFreeze(double t, double rh, double cwc){
    bool f1 = (t<=23) && (rh>cwc) && (t>=32);
    bool f2 = (t>=32) && (rh>cwc) && (t<=23);
    return (f1 || f2);
  }
# ---------- end freeze ----------
