# Grasshopper definition iterator testing.gh (Grasshopper 0.9.76)
# plug-ins: Colibri

panel = Panel("""5
3
11""")
mingbo = Slider(0, range=0..10)
hanshen = Slider(3, range=0..10)
olivier = Slider(0, range=0..10)
iterator = Iterator(Sliders=[mingbo, hanshen, olivier], Steps=panel, Fly=Button())
panel_2 = Panel(iterator)
